# Grasshopper definition assembly_design.ghx (Grasshopper 1.0.8)

insulated_bricks = Geometry([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])
full_bricks = Geometry([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])
compas = Python3Script()  # -> out
# ---------- compas: Python ----------
import compas
print(compas.__version__)
# ---------- end compas ----------

# ----
# Generate brick parts
part = Python3Script()  # -> out, brick_full, brick_insulated, brick_air_dried, brick_perforated, brick_half
# ---------- part: Python ----------
import os
from compas.geometry import Frame, Box
from compas.datastructures import Mesh
from climate_active_envelopes.assembly import CAEPart as Part



#brick_full
length, width, height = 0.24, 0.115, 0.071
brick_full = Part.from_dimensions(name = "brick_full", length=length, width=width, height=height)
#print(brick_full.attributes)
#print(brick_full.__data__)

#brick_air_dried
length, width, height = 0.24, 0.115, 0.071
brick_air_dried = Part.from_dimensions(name = "brick_air_dried", length=length, width=width, height=height)

#brick_insulated_placeholder_new
length, width, height = 0.24, 0.115, 0.071
brick_insulated = Part.from_dimensions(name = "brick_insulated", length=length, width=width, height=height)


# #brick_insulated_placeholder
# length, width, height = 0.245, 0.12, 0.075
# brick_insulated = Part.from_dimensions(length=length, width=width, height=height)
# brick_insulated.attributes['name'] = "brick_insulated"
# print(brick_insulated.__data__)

#corner brick
length, width, height = 0.24, 0.0575, 0.071
brick_half = Part.from_dimensions(name = "brick_half", length=length, width=width, height=height)

#brick_insulated
# package_path = ghdoc.Path
# data_path = os.path.abspath(os.path.join(package_path,"../../../climate_active_envelopes/data/brick_types"))
# filename = 'brick_insulated_reduced.stl'
# brick_insulated_mesh = Mesh.from_stl(os.path.join(data_path, filename))
# brick_insulated = Part.from_mesh_and_frame(brick_insulated_mesh)
# brick_insulated.attributes['name'] = "brick_insulated"
# #print(brick_insulated.__data__)

#brick Hochlochziegel
length, width, height = 0.247, 0.365, 0.249
brick_perforated = Part.from_dimensions(name = "brick_perforated", length=length, width=width, height=height)
# ---------- end part ----------
list = ValueList({"none", "full", "insulated", "perforated", "half"}, selected="none")
draw = Python3Script(
    brick_full=part.brick_full,
    brick_insulated=part.brick_insulated,
    brick_perforated=part.brick_perforated,
    brick_half=part.brick_half,
    show=list)  # -> M, P
# ---------- draw: Python ----------
from compas_rhino.conversions import mesh_to_rhino, box_to_rhino, frame_to_rhino
from climate_active_envelopes.assembly import CAEPart as Part
from compas.geometry import Frame
from compas.geometry import Vector
from compas.geometry import Box


if show=="full":

    #extract the mesh of the part for visulization
    compas_mesh_full = brick_full.mesh

    #convert to rhino mesh
    M = mesh_to_rhino(compas_mesh_full)

    #extract and convert to rhino plane
    P = frame_to_rhino(brick_full.frame)
    #brick_full.gripping_frame = full_brick.frame
    #print(full_brick.__data__)
    print(type(brick_full))

    
elif show == "insulated":
    
    #extract the mesh of the part for visulization
    compas_mesh_insulated = brick_insulated.mesh

    #convert to rhino mesh
    M = mesh_to_rhino(compas_mesh_insulated)
    
    #extract and convert to rhino plane
    P = frame_to_rhino(brick_insulated.frame)

elif show == "half":

    #extract the mesh of the part for visulization
    compas_mesh_half = brick_half.mesh

    #convert to rhino mesh
    M = mesh_to_rhino(compas_mesh_half)
    
    #extract and convert to rhino plane
    P = frame_to_rhino(brick_half.frame)

elif show == "perforated":
    #extract the mesh of the part for visulization
    compas_mesh_perforated = brick_perforated.mesh

    #convert to rhino mesh
    M = mesh_to_rhino(compas_mesh_perforated)
    
    #extract and convert to rhino plane
    P = frame_to_rhino(brick_perforated.frame)

else:
    pass
# ---------- end draw ----------
mesh = Mesh(draw.M)
pln = Plane(draw.P)

# ----
# Unload Python modules
button = Button()
unload = Python3Script(unload=button)  # -> out, a
# ---------- unload: Python ----------
#from compas_ghpython import unload_modules
from compas_rhino import unload_modules

unload_modules('climate_active_envelopes')
unload_modules('assembly_information_model')
# ---------- end unload ----------

compas___version = Panel(compas)

# ----
# Create empty assembly
# datastructure
button_2 = Button()
assembly = Python3Script(init=button_2)  # -> out, my_assembly
# ---------- assembly: Python ----------
from climate_active_envelopes.assembly import CAEAssembly as Assembly

#create empty assembly
my_assembly = Assembly()
# ---------- end assembly ----------

context_input = Brep(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)
epw_file = FilePath("C:\Users\julia\workspace\climate_active_envelopes\rhino\DEU_BY_Munich-Theresienwiese.108650_TMYx.epw")

number_slider = Slider(0, range=0..360)

list_2 = ValueList({"rotate", "translate"}, selected="translate")
list_3 = ValueList({"clockwise": "right", "counter clockwise": "left"}, selected="clockwise")
transform = Button()
reset = Button()

compute = BooleanToggle(True)

# ----
# Brick Assembly & Brick Parts
input_surface = Brep(<brep referenced from the Rhino model>)
list_4 = ValueList({"From Reference Model": "reference_model", "From Input Surface": "mesh"}, selected="From Input Surface")

list_5 = ValueList({"Cross": "cross", "Diamond_L": "diamond_large", "Diamond_S": "diamond_small"}, selected="Diamond_S")

# ----
# Face Classification
next_face = Button()
previous_face = Button()
reset_2 = Button()

next_neighbor = Button()
next_edge = Button()

start = Button()
stop = Button()
step = Button()
back = Button()
reset_3 = Button()
full = Button()
list_6 = ValueList({"20", "50", "100", "500", "1000", "5000"}, selected="500")

show_face_neighbor_until_key = BooleanToggle(False)
show_inner_wall_neighbors = BooleanToggle(False)
show_wall_neighbors = BooleanToggle(False)
show_slab_neighbors = BooleanToggle(False)
show_face_neighbor = BooleanToggle(False)
show_current_edge = BooleanToggle(True)

show_face_until_key = BooleanToggle(False)
show_current_face = BooleanToggle(True)
show_all = BooleanToggle(True)

list_7 = ValueList({"show all": "show_all", "show until key": "show_until_key", "show nothing": "show_nothing", "show connections": "show_connections", "show patches": "show_patches"}, selected="show all")

# ----
# Reference Model & Building Elements
# Create Reference Model
geo = Geometry(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)
geo_2 = Geometry(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)

quad = Quadrangulate(Mesh=geo_2, Angle=0.03490658504, Ratio=0.875)  # -> Mesh, Count
quad_2 = Quadrangulate(Mesh=geo, Angle=0.03490658504, Ratio=0.875)  # -> Mesh, Count
referencemodel = Python3Script(units=[quad_2.Mesh, quad.Mesh])  # -> out, reference_model; inputs units: list of Mesh
# ---------- referencemodel: Python ----------
from climate_active_envelopes.assembly import CAEReferenceModel 
from compas_rhino.conversions import mesh_to_compas
from compas.datastructures import Mesh, CellNetwork


reference_model = CAEReferenceModel()

mesh_units = []
print(mesh_units)
for unit in units:
    mesh_units.append(mesh_to_compas(unit))

reference_model = reference_model.create_cell_network(mesh_units)
print(reference_model)

reference_model.initialize_network()
# ---------- end referencemodel ----------

cell_network = Panel(referencemodel.out)

face_types = Python3Script(reference_model=referencemodel.reference_model, next_face=next_face, previous_face=previous_face, reset=reset_2)  # -> out, current_face_type, reference_model, fkey
# ---------- face_types: Python ----------
from scriptcontext import sticky as st

#st["edge_key"] = edge_key
#st["face_key"] = face_key


print(reference_model)
L = range(reference_model.number_of_faces())

#store data in component
guid = str(ghenv.Component.InstanceGuid)
face_key = "key_" + guid
running_key = "running_" + guid



if face_key not in st:
    st[face_key] = 0

if next_face:
    if st[face_key] < len(L) - 1:
        st[face_key] += 1
    else:
        st[face_key] = 0 

if previous_face:
    if st[face_key] < len(L) - 1:
        st[face_key] -= 1
    else:
        st[face_key] = 0 

if reset:
    st[face_key] = 0
    st[running_key] = False

fkey = st[face_key]


#Category for all faces in all cells
face_types = reference_model.sort_faces_by_type()

# Print the face_type of the faces in face_types['walls']
for face, face_type in face_types['walls']:
    print(face, face_type)

# Print the face_type of all faces in face_types
all_faces_type = []
for faces in face_types.values():
    for face, face_type in faces:
        all_faces_type.append(face_type)


# Category for selected face
current_face, current_face_type = reference_model.select_face_by_fkey(fkey)


# Category of neighboring faces
neighbor_faces_type = []
neighbors, neighbor_face_types = (reference_model.select_face_neighbors(fkey))
for neighbor, face_type in neighbor_face_types:
    neighbor_faces_type.append(face_type)

wall_neighbors = []
slab_neighbors = []
neighbors, neighbor_face_types = reference_model.select_face_neighbors(fkey)

for neighbor, face_type in neighbor_face_types:
    if face_type in ["outer wall", "inner wall"]:
        wall_neighbors.append(neighbor)

    if face_type in ["slab"]:
        slab_neighbors.append(neighbor)

# Store wall_neighbors and slab_neighbors in reference_model
reference_model.wall_neighbors = wall_neighbors
reference_model.slab_neighbors = slab_neighbors

# Store face_key to the reference_model
reference_model.fkey = fkey

# Store current_face with fkey in reference_model
reference_model.current_face = current_face
reference_model.current_face_type = current_face_type
# ---------- end face_types ----------
panel = Panel(face_types.current_face_type)
panel_2 = Panel(face_types.fkey)

edge_types = Python3Script(reference_model=face_types.reference_model, next_neighbor=next_neighbor, next_edge=next_edge)  # -> out, shared_edge_type, current_edge_type, reference_model, ekey
# ---------- edge_types: Python ----------
from compas_rhino.conversions import mesh_to_rhino, line_to_rhino
from scriptcontext import sticky as st

face_neighbors = reference_model.wall_neighbors + reference_model.slab_neighbors
L = range(len(reference_model.wall_neighbors))

#store data in component
guid = str(ghenv.Component.InstanceGuid)
face_edge_key = "key_" + guid

if face_edge_key not in st:
    st[face_edge_key] = 0

if next_neighbor:
    if st[face_edge_key] < len(L) - 1:
        st[face_edge_key] += 1
    else:
        st[face_edge_key] = 0 

face_edge_key = st[face_edge_key]+1

# Store face_key to the reference_model
reference_model.face_edge_key = face_edge_key

# Get type of the shared edge
shared_edge, edge_type = reference_model.get_shared_edge(reference_model.current_face, reference_model.wall_neighbors, face_edge_key)
shared_edge_type = edge_type

# Store edge_type and shared_edge in reference_model
reference_model.shared_edge = shared_edge
reference_model.shared_edge_type = shared_edge_type







L = range(reference_model.number_of_edges())


edge_key = "ekey_" + guid
if edge_key not in st:
    st[edge_key] = 0
if next_edge:
    if st[edge_key] < len(L) - 1:
        st[edge_key] += 1
    else:
        st[edge_key] = 0 
ekey = st[edge_key]+1

# Store face_key to the reference_model
reference_model.ekey = ekey



current_edge, current_edge_type = reference_model.select_edge_by_ekey(ekey)
reference_model.current_edge = current_edge

print(current_edge, current_edge_type)
face_edges = reference_model.face_edges(reference_model.current_face)
print(face_edges)
#print(reference_model.select_face_and_get_adjacent_edges(reference_model.fkey))
# ---------- end edge_types ----------
panel_3 = Panel(edge_types.ekey)
panel_4 = Panel(edge_types.current_edge_type)
panel_5 = Panel(edge_types.shared_edge_type)

# ----
# Create brick assembly
number_slider_2 = Slider(0.01, range=0..0.1)
course_height = Slider(0.081, range=0..1)
list_8 = ValueList({"Flemish bond": "flemish_bond", "Vertical bond": "vertical_bond"}, selected="Vertical bond")
list_9 = ValueList({"Single layer": "single_layer", "Double layer": "double_layer"}, selected="Double layer")
create_assembly = Python3Script(
    compute=compute,
    reference_model=edge_types.reference_model,
    my_assembly=assembly.my_assembly,
    surface=input_surface,
    input_type=list_4,
    bond_type=list_8,
    ornament_type=list_5,
    wall_system=list_9,
    brick_full=part.brick_full,
    brick_insulated=part.brick_insulated,
    brick_air_dried=part.brick_air_dried,
    brick_perforated=part.brick_perforated,
    brick_half=part.brick_half,
    brick_spacing=number_slider_2,
    course_height=course_height)  # -> out, start_edge_type, end_edge_type, current_face_type, my_assembly; inputs surface: Surface, brick_spacing: Double, course_height: Double
# ---------- create_assembly: Python ----------
from compas_rhino.conversions import mesh_to_compas, surface_to_compas_mesh


if compute:
    mesh = surface_to_compas_mesh(surface, 1)

    my_assembly.set_brick_params(brick_full, brick_insulated, brick_half, brick_air_dried)


    if input_type == "reference_model":
        input_data = reference_model


    if input_type == "mesh":
        input_data = mesh

    assembly_data = (reference_model.generate_assembly_data(input_data, course_height, input_type))
    print(assembly_data)
    start_edge_type = assembly_data['start_edge_type']
    end_edge_type = assembly_data['end_edge_type']
    current_face_type = assembly_data['face_type']

    my_assembly.generate_wall(reference_model,
                        bond_type, 
                        ornament_type,
                        wall_system,  
                        brick_spacing, 
                        course_height,
                        input_type,
                        input_data,

                        )
# ---------- end create_assembly ----------
panel_6 = Panel(create_assembly.start_edge_type)
panel_7 = Panel(create_assembly.end_edge_type)
panel_8 = Panel(create_assembly.current_face_type)

# ----
# Visualisation Reference Model
vizualize_reference_model = Python3Script(
    reference_model=face_types.reference_model,
    show_all=show_all,
    show_current_face=show_current_face,
    show_face_until_key=show_face_until_key)  # -> P, L, M, mesh_till_key, current_mesh
# ---------- vizualize_reference_model: Python ----------
from compas.geometry import Frame
from compas_rhino.conversions import frame_to_rhino, line_to_rhino, mesh_to_rhino
from scriptcontext import sticky as st


fkey = reference_model.fkey


if show_all:
    P = []
    for vertex_key in reference_model.vertices():
        coordinates = reference_model.vertex_coordinates(vertex_key)
        #print(f"Vertex Key: {vertex_key}, Coordinates: {coordinates}")
        frames = Frame(coordinates, [1, 0, 0], [0, 1, 0])
        rhino_planes = frame_to_rhino(frames)
        P.append(rhino_planes)

    L = []
    for edge in reference_model.edges():
        print(edge)
        line = reference_model.edge_line(edge)
        curves = line_to_rhino(line)
        L.append(curves)

    M = []
    for face in reference_model.faces():
        face_meshes = reference_model.faces_to_mesh([face])
        mesh = mesh_to_rhino(face_meshes)
        M.append(mesh)

if show_face_until_key:
    all_face_meshes = []
    for face in reference_model.faces():
        face_mesh = reference_model.faces_to_mesh([face])
        all_face_meshes.append(face_mesh)
    mesh_till_key = [mesh_to_rhino(face_mesh) for face_mesh in all_face_meshes[:int(fkey)]]

if show_current_face:
    selected_face, face_type = reference_model.select_face_by_fkey(fkey)
    current_face_mesh = reference_model.faces_to_mesh([selected_face])
    current_mesh = mesh_to_rhino(current_face_mesh) 


# wall_neighbors = []
# slab_neighbors = []
# neighbors, neighbor_face_types = reference_model.select_face_neighbors(fkey)
# for neighbor, face_type in neighbor_face_types:
#     if show_wall_neighbors:
#         if face_type in ["outer wall", "inner wall"]:
#             neighbor_faces_meshes = reference_model.faces_to_mesh([neighbor])
#             mesh_neighbor = mesh_to_rhino(neighbor_faces_meshes)
#             wall_neighbors.append(mesh_neighbor)
#     if show_slab_neighbors:
#         if face_type in ["slab"]:
#             neighbor_faces_meshes = reference_model.faces_to_mesh([neighbor])
#             mesh_neighbor = mesh_to_rhino(neighbor_faces_meshes)
#             slab_neighbors.append(mesh_neighbor)
# ---------- end vizualize_reference_model ----------
crv = Curve(vizualize_reference_model.L)
points = Point(vizualize_reference_model.P)

# ----
# Climatic Simulation to unlock self-shading properties
# Shading Simulation
toggle = BooleanToggle(True)
to_brep = Python3Script(convert=toggle, input_type=list_4, current_mesh=vizualize_reference_model.current_mesh, input_surface=input_surface)  # -> current_brep; inputs current_mesh: Mesh, input_surface: Brep
# ---------- to_brep: Python ----------
import Rhino.Geometry as rg


if convert:

    if input_type == "reference_model":
        current_brep = rg.Brep.CreateFromMesh(current_mesh, True)

    if input_type == "mesh":
        current_brep = input_surface
    # Convert the mesh to a Brep
# ---------- end to_brep ----------
run = BooleanToggle(True)
sun_hours = SunHours(
    start_month=Slider(6, range=0..10),
    start_day=Slider(1, range=0..10),
    start_hour=Slider(11, range=0..100),
    end_month=Slider(8, range=0..10),
    end_day=Slider(31, range=0..100),
    end_hour=Slider(16, range=0..100),
    north=number_slider,
    geometry=to_brep,
    epw_file=epw_file,
    context=context_input,
    grid_size=Slider(0.04, range=0..0.1),
    run=run)  # -> hoys, location, points, results, sky_mtx, mesh, legend
geo_3 = Geometry(sun_hours.legend)
panel_9 = Panel(geo_3)

# ----
# Sun Path
number_slider_3 = Slider(0.4, range=0..10)
pt = Point(Point(-6.494743299, -6.882496362, 0))
sunpath = LBSunPath(north=number_slider, location=sun_hours.location, hoys=sun_hours.hoys, center_pt=pt, scale=number_slider_3)  # -> report, vectors, altitudes, azimuths, hoys, sun_pts, analemma, daily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; plug-in component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
geo_4 = Geometry([sunpath.compass, sunpath.daily, sunpath.analemma, sunpath.legend, sunpath.title, sunpath.sun_pts])

# ----
# Apply Gradient
values = Python3Script(results=sun_hours.results, min_value=Slider(-0.5, range=-2..2), max_value=Slider(0.7, range=-2..2))  # -> out, normalized_values; inputs results: list
# ---------- values: Python ----------
from compas.itertools import normalize_values



def normalize_to_highest(values, max_value=140.0, target_min=0.1, target_max=1):
    """Normalizes a list of values based on the highest value in the list, 
    scaled to a specific range.

    Args:
    values: A list of numerical values.
    max_value: The expected maximum value. Defaults to 140.0.
    target_min: The minimum value of the target range. Defaults to 0.0.
    target_max: The maximum value of the target range. Defaults to 1.0.

    Returns:
    A list of normalized values.
    """
    highest_value = max(values)

    factor = highest_value / max_value
    print(factor)  # Calculate the scaling factor
    normalized_values = normalize_values(values, target_min, target_max * factor)
    return normalized_values

normalized_values = normalize_values(results, min_value, max_value)
#normalized_values = normalize_to_highest(results)
#print(color_values)

print(max(normalized_values))

print(normalized_values)
# ---------- end values ----------
keys = Python3Script(my_assembly=create_assembly.my_assembly, transform_type=list_2)  # -> out, my_assembly, keys; inputs transform_type: String
# ---------- keys: Python ----------
# for node_id in my_assembly.graph.nodes():
#     transform_type = my_assembly.graph.node_attribute(node_id, 'transform_type')





keys = []
for key in my_assembly.graph.nodes_where({"transform_type": transform_type}):
    keys.append(key)

print(keys)
print(transform_type)
# ---------- end keys ----------
apply_gradient = Python3Script(
    my_assembly=keys.my_assembly,
    normalized_values=values.normalized_values,
    pts=sun_hours.points,
    keys=keys.keys,
    transform_type=list_2,
    rotation_direction=list_3,
    nrbh_size=Slider(2000, range=3..2000),
    transform=transform,
    reset=reset)  # -> out, my_assembly; inputs normalized_values: list, pts: list of Point3d, keys: list, nrbh_size: Int32
# ---------- apply_gradient: Python ----------
from compas_rhino.conversions import point_to_compas



#print(my_assembly.__data__)

transform_types = {node_id: my_assembly.graph.node_attribute(node_id, 'transform_type') for node_id in my_assembly.graph.nodes()}
#print(transform_types)
points = []
for p in pts:
    point = point_to_compas(p)
    points.append(point)

if transform:
    my_assembly.apply_gradient(normalized_values,points,keys,transform_type, rotation_direction, nrbh_size, reset=False)

if reset:
    my_assembly.apply_gradient(normalized_values,points,keys,transform_type, rotation_direction, nrbh_size, reset=True)
# ---------- end apply_gradient ----------

visualize = Python3Script(show=Toggle(False), mesh=sun_hours.mesh)  # -> out, M
# ---------- visualize: Python ----------
if show == True:
    M = mesh
# ---------- end visualize ----------
mesh_2 = Mesh(visualize.M)

# ----
# Transform
toggle_2 = BooleanToggle(False)
pln_2 = Plane(PlaneXY(2.43007085, -1.968439302, -0.2055923429))
transform_2 = Python3Script(my_assembly=apply_gradient.my_assembly, transform=toggle_2, origin_plane=pln, new_origin_plane=pln_2)  # -> out, my_assembly; disabled
# ---------- transform_2: Python ----------
from compas.geometry import Frame, Transformation, Rotation, Translation
from compas_rhino.conversions import plane_to_compas_frame


new_origin_frame = plane_to_compas_frame(new_origin_plane)
origin_frame = plane_to_compas_frame(origin_plane)

if transform:
    T = Transformation.from_frame_to_frame(origin_frame, new_origin_frame)
    my_assembly = my_assembly.transformed(T)
# ---------- end transform_2 ----------

# ----
# Visualisation Assembly
counter = Python3Script(
    my_assembly=apply_gradient.my_assembly,
    start=start,
    stop=stop,
    step=step,
    step_back=back,
    reset=reset_3,
    full=full,
    interval=list_6)  # -> out, counter
# ---------- counter: Python ----------
from scriptcontext import sticky as st
import Grasshopper

def update_component(ghenv, delay):
    """Schedule an update of the Grasshopper component.

    After the specified delay, the GH component will be automatically updated.

    Parameters
    ----------
    ghenv : :class:`GhPython.Component.PythonEnvironment`
        The current GHPython environment.
    delay : :obj:`int`
        Time in milliseconds until the update is performed.

    Raises
    ------
    ValueError
        If the delay is less than zero.

    """
    if delay <= 0:
        raise ValueError("Delay must be greater than zero")

    ghcomp = ghenv.Component
    ghdoc = ghcomp.OnPingDocument()

    def callback(ghdoc):
        if ghdoc.SolutionState != Grasshopper.Kernel.GH_ProcessStep.Process:
            ghcomp.ExpireSolution(False)

    ghdoc.ScheduleSolution(delay, Grasshopper.Kernel.GH_Document.GH_ScheduleDelegate(callback))

L = range(my_assembly.graph.number_of_nodes())

# store data in component
guid = str(ghenv.Component.InstanceGuid)
counter_key = "counter_" + guid
running_key = "running_" + guid

if counter_key not in st:
    st[counter_key] = 0

if running_key not in st:
    st[running_key] = False
    

if st[running_key]:
    if st[counter_key] < len(L) - 1:
        st[counter_key] += 1
        update_component(ghenv, interval)
    else:
        st[counter_key] = 0
        st[running_key] = False
    
if start:
    st[running_key] = True

if stop:
    st[running_key] = False

if step:
    if st[counter_key] < len(L) - 1:
        st[counter_key] += 1

if step_back:
    if st[counter_key] < len(L) - 1:
        st[counter_key] -= 1

if reset:
    st[counter_key] = 0
    st[running_key] = False

if full:
    st[counter_key] = len(L)-1

if len(L):
    item = L[st[counter_key]]


#st["visualisation_counter"] = st[counter_key]
counter = st[counter_key]+1
# ---------- end counter ----------
panel_10 = Panel(counter.counter)
visualize_2 = Python3Script(my_assembly=apply_gradient.my_assembly, show=list_7, highlight_current_part=Toggle(False), counter=panel_10)  # -> out, parts_geometry, brick_full_geometry, brick_insulated_geometry, brick_air_dried_geometry, parts_frame, current_part_geometry, current_part_frame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
# ---------- visualize_2: Python ----------
from compas_rhino.conversions import mesh_to_rhino, box_to_rhino, frame_to_rhino
import Rhino.Geometry as rg
import ghpythonlib.components as ghcomp
from compas.colors import Color


#print assembly
print(my_assembly)
#counter = int(counter)

#get parts datastructure
parts = [p for p in my_assembly.parts()]
connections = []
patches = []
patches_color = []
#get current part
brick_full_parts = [p for p in parts if my_assembly.graph.node_attribute(p.key, "brick_type") == "full"]
brick_insulated_parts = [p for p in parts if my_assembly.graph.node_attribute(p.key, "brick_type") == "insulated"]

if show == "show_all":
    
    brick_full_geometry = []
    brick_insulated_geometry = []
    parts_frame = []

    brick_full_geometry = [mesh_to_rhino(p.mesh) for p in brick_full_parts]
    brick_insulated_geometry = [mesh_to_rhino(p.mesh) for p in brick_insulated_parts]
    
    #extract the frame of the parts for visulization (+ converted to rhino plane)
    parts_frame = [frame_to_rhino(p.frame) for p in parts]

    key = my_assembly.graph.number_of_nodes()-1

# if show == "show_all":
    
# #get parts datastructure
#     parts = [p for p in my_assembly.parts()]
#     parts_geometry = []
#     parts_frame = []

#     #part = parts[0]
#     #print(part.gripping_frame)

#     #extract the mesh of the parts for visulization (+ converted to rhino mesh)
#     parts_geometry = [mesh_to_rhino(p.mesh) for p in parts]
    
#     #extract the frame of the parts for visulization (+ converted to rhino plane)
#     parts_frame = [frame_to_rhino(p.frame) for p in parts]
#     print(parts_frame)

#     key = my_assembly.graph.number_of_nodes()-1

if show == "show_until_key":
    #extract the mesh of the parts for visulization (+ converted to rhino mesh)
    parts_geometry = [mesh_to_rhino(p.mesh) for p in parts[0:int(counter)]]
    #extract the frame of the parts for visulization (+ converted to rhino plane)
    parts_frame = [frame_to_rhino(p.frame) for p in parts[0:int(counter)]]
    key = int(counter)-1

if show == "show_nothing":
    print("Nothing to see")
    pass

if show == "show_connections":
    edges = list(my_assembly.connections())
    for e in edges:
        p1 = my_assembly.part(e[0]).frame.point
        p2 = my_assembly.part(e[1]).frame.point
        connections += [rg.Line(p1[0],p1[1],p1[2],p2[0],p2[1],p2[2])]

if show == "show_patches":
    c_max = max(my_assembly.graph.nodes_attribute(name='patch')) + 1
    for patch_index in range(1, c_max):
        keys_in_patch = list(my_assembly.graph.nodes_where({'patch': patch_index}))
        parts = [my_assembly.part(key) for key in keys_in_patch]
        for p in parts:
            patches.append(mesh_to_rhino(p.mesh))
            color_value = (1 - patch_index / c_max) - 0.2
            color_value = max(0, min(color_value, 1))  # Ensure the color value is within [0, 1]   
            r = int(255 * (3*color_value))
            g = int(255 * (5*color_value))
            b = int(255 * (1.5*color_value))          
            patches_color.append(ghcomp.ColourRGB(r, g, b))


if highlight_current_part:
    current_part = my_assembly.part(key)
    current_part_geometry = mesh_to_rhino(current_part.mesh)
    current_part_frame = frame_to_rhino(current_part.frame)
    current_part_gripping_frame = frame_to_rhino(current_part.gripping_frame)
    
    print(current_part.__data__)
# ---------- end visualize_2 ----------
panel_11 = Panel(visualize_2.out)
geo_5 = Geometry(visualize_2.parts_frame)
geo_6 = Geometry(visualize_2.brick_insulated_geometry)
geo_7 = Geometry(visualize_2.connections)
geo_8 = Geometry([visualize_2.current_part_frame, visualize_2.current_part_geometry])
geo_9 = Geometry(visualize_2.current_part_gripping_frame)
geo_10 = Geometry(visualize_2.patches)
geo_11 = Geometry([visualize_2.parts_geometry, visualize_2.brick_full_geometry])
preview = CustomPreview(Geometry=geo_11, Material=ColourSwatch(SwatchColor=RGB(196, 141, 141)))
preview_2 = CustomPreview(Geometry=geo_6, Material=ColourSwatch(SwatchColor=RGB(199, 134, 123)))
preview_3 = CustomPreview(Geometry=geo_5, Material=ColourSwatch(SwatchColor=RGB(255, 125, 157)))
preview_4 = CustomPreview(Geometry=geo_8, Material=ColourSwatch(SwatchColor=RGB(255, 125, 157)))
preview_5 = CustomPreview(Geometry=geo_9, Material=ColourSwatch(SwatchColor=RGB(255, 125, 157)))
preview_6 = CustomPreview(Geometry=geo_7, Material=ColourSwatch(SwatchColor=RGB(177, 255, 157)))
preview_7 = CustomPreview(Geometry=geo_10, Material=visualize_2.patches_color)
draw_2 = Python3Script(planes=geo_9, scale=Slider(0.2, range=0..1))  # -> out, P, V, C, W; inputs planes: list of Plane
# ---------- draw_2: Python ----------
from System.Drawing import Color

red = Color.FromArgb(255, 0, 0)
green = Color.FromArgb(0, 255, 0)
blue = Color.FromArgb(0, 0, 255)

P = []
V = []
C = []

scale = float(scale)

for plane in planes:
    if not plane:
        continue
    P += [plane.Origin] * 3
    V.append(plane.XAxis * scale)
    V.append(plane.YAxis * scale)
    V.append(plane.ZAxis * scale)
    C += [red, green, blue]

W = 3
# ---------- end draw_2 ----------
vdisex = VectorDisplayEx(Point=draw_2.P, Vector=draw_2.V, Colour=draw_2.C, Width=draw_2.W)

vizualize_face_neighbors = Python3Script(
    reference_model=edge_types.reference_model,
    show_wall_neighbors=show_wall_neighbors,
    show_slab_neighbors=show_slab_neighbors,
    show_inner_wall_neighbors=show_inner_wall_neighbors,
    show_face_neighbor=show_face_neighbor,
    show_face_neighbor_unil_key=show_face_neighbor_until_key,
    show_current_edge=show_current_edge)  # -> out, wall_neighbors, slab_neighbors, inner_wall_neighbors, next_neighbor, neighbor_until_key, current_curve
# ---------- vizualize_face_neighbors: Python ----------
from compas_rhino.conversions import mesh_to_rhino, line_to_rhino
from scriptcontext import sticky as st

# face_neighbors = reference_model.wall_neighbors + reference_model.slab_neighbors
# L = range(len(reference_model.wall_neighbors))

# #store data in component
# guid = str(ghenv.Component.InstanceGuid)
# edge_key = "key_" + guid

# if edge_key not in st:
#     st[edge_key] = 0

# if next_neighbor:
#     if st[edge_key] < len(L) - 1:
#         st[edge_key] += 1
#     else:
#         st[edge_key] = 0 

# ekey = st[edge_key]+1
face_edge_key = reference_model.face_edge_key
ekey = reference_model.ekey
fkey = reference_model.fkey


wall_neighbors = []
slab_neighbors = []
neighbors, neighbor_face_types = reference_model.select_face_neighbors(fkey)

for neighbor, face_type in neighbor_face_types:
    if show_wall_neighbors:
        if face_type in ["outer wall", "inner wall"]:
            neighbor_faces_meshes = reference_model.faces_to_mesh([neighbor])
            mesh_neighbor = mesh_to_rhino(neighbor_faces_meshes)
            wall_neighbors.append(mesh_neighbor)
    if show_slab_neighbors:
        if face_type in ["slab"]:
            neighbor_faces_meshes = reference_model.faces_to_mesh([neighbor])
            mesh_neighbor = mesh_to_rhino(neighbor_faces_meshes)
            slab_neighbors.append(mesh_neighbor)



edge_type = reference_model.shared_edge_type
shared_edge = reference_model.shared_edge


inner_wall_neighbors = []
edge_faces = reference_model.edge_faces(shared_edge)
if show_inner_wall_neighbors:
    for face in edge_faces:
         if face != reference_model.current_face:
            if edge_type == 'inner wall joint':
                neighbor = mesh_to_rhino(reference_model.faces_to_mesh([face]))
                inner_wall_neighbors.append(neighbor)
            else:
                neighbor = mesh_to_rhino(reference_model.faces_to_mesh([face]))
                inner_wall_neighbors.append(neighbor)

neighbor_face_meshes = []
for i, face in enumerate(reference_model.wall_neighbors):
    if i < face_edge_key:

        #Vizualize the neighboring faces (one-by-one and until key)
        if show_face_neighbor:
            next_neighbor = mesh_to_rhino(reference_model.faces_to_mesh([face]))

        if show_face_neighbor_unil_key:
            neighbor_face_meshes.append(reference_model.faces_to_mesh([face]))
            neighbor_until_key = [mesh_to_rhino(face_mesh) for face_mesh in neighbor_face_meshes[:int(face_edge_key)]]


# Vizualize the shared edge
shared_edge = reference_model.get_shared_edge(reference_model.current_face, reference_model.wall_neighbors, face_edge_key)
shared_edge_type = shared_edge[1]
edge_between_faces = []
line = reference_model.edge_line(shared_edge[0])
curves = line_to_rhino(line)
edge_between_faces.append(curves)

# Vizualize current edge
if show_current_edge:
    current_edge = reference_model.current_edge
    current_curve = line_to_rhino(reference_model.edge_line(current_edge))
# ---------- end vizualize_face_neighbors ----------

# ----
# Export to JSON
export = Button()
path = Python3Script()  # -> HERE, DATA, ASSEMBLY
# ---------- path: Python ----------
import os

HERE = os.path.dirname(ghdoc.Path)
DATA = os.path.abspath(os.path.join(HERE, "..", "data"))
ASSEMBLY = os.path.abspath(os.path.join(DATA, "assembly"))

print(HERE)
print(DATA)
print(ASSEMBLY)
# ---------- end path ----------
export_2 = Python3Script(ASSEMBLY=path.ASSEMBLY, my_assembly=transform_2.my_assembly, export=export)  # -> out; inputs ASSEMBLY: String
# ---------- export_2: Python ----------
import os


    

#print(my_assembly.__data__)
if export:
    #print(DATA)
    filename = "250211_brickwall_2.json"
    PATH = os.path.join(ASSEMBLY, filename)

    # the assembly has to be serialized such that it can be called from CPython
    my_assembly.to_json(PATH, pretty=True)
    print(my_assembly)
# ---------- end export_2 ----------

preview_8 = CustomPreview(
    Geometry=[vizualize_face_neighbors.wall_neighbors, vizualize_face_neighbors.slab_neighbors],
    Material=ColourSwatch(SwatchColor=RGB(181, 125, 157)))
preview_9 = CustomPreview(
    Geometry=[vizualize_face_neighbors.inner_wall_neighbors, vizualize_face_neighbors.next_neighbor],
    Material=ColourSwatch(SwatchColor=RGB(255, 216, 203)))
preview_10 = CustomPreview(
    Geometry=[vizualize_face_neighbors.neighbor_until_key, vizualize_face_neighbors.current_curve],
    Material=ColourSwatch(SwatchColor=RGB(255, 131, 138)))

preview_11 = CustomPreview(Geometry=vizualize_reference_model.mesh_till_key, Material=ColourSwatch(SwatchColor=RGB(255, 125, 157)))
preview_12 = CustomPreview(Geometry=vizualize_reference_model.current_mesh, Material=ColourSwatch(SwatchColor=RGB(255, 194, 157)))

# ----
# Radiation Simulation
run_2 = BooleanToggle(True)

py3 = Python3Script(bricks=visualize_2.brick_full_geometry, run=run_2)  # -> out, brick_geo, geometry; inputs bricks: list of Mesh
# ---------- py3: Python ----------
if run == False:
    brick_geo = bricks
else:
    _geometry = bricks
# ---------- end py3 ----------
preview_13 = CustomPreview(Geometry=py3.brick_geo, Material=ColourSwatch(SwatchColor=RGB(196, 141, 141)))

radiation_simulation = RadiationSimulation(sky_mtx=sun_hours.sky_mtx, geometry=py3.geometry, context=context_input, run=run_2)  # -> mesh, legend
brick_wall = Mesh(radiation_simulation.mesh)
geo_12 = Geometry(radiation_simulation.legend)

# ==== cluster SunHours
epw_file = ClusterInput()
start_month = ClusterInput()
start_day = ClusterInput()
start_hour = ClusterInput()
end_month = ClusterInput()
end_day = ClusterInput()
end_hour = ClusterInput()
importepw = LBImportEPW(epw_file=epw_file)  # -> location, dry_bulb_temperature, dew_point_temperature, relative_humidity, wind_speed, wind_direction, direct_normal_rad, diffuse_horizontal_rad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; plug-in component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
analysisperiod = LBAnalysisPeriod(
    start_month=start_month,
    start_day=start_day,
    start_hour=start_hour,
    end_month=end_month,
    end_day=end_day,
    end_hour=end_hour)  # -> period, hoys, dates; plug-in component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
hoys = ClusterOutput(analysisperiod.hoys)
north = ClusterInput()
skymatrix = LBCumulativeSkyMatrix(
    north=north,
    location=importepw.location,
    direct_rad=importepw.direct_normal_rad,
    diffuse_rad=importepw.diffuse_horizontal_rad,
    hoys=analysisperiod.hoys)  # -> report, sky_mtx; plug-in component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
location = ClusterOutput(importepw.location)
sky_mtx = ClusterOutput(skymatrix.sky_mtx)
colrange = LBColorRange(index=Slider(5, range=0..100))  # -> colors; plug-in component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
base_plane = ClusterInput()
geometry = ClusterInput()
context = ClusterInput()
grid_size = ClusterInput()
run = ClusterInput()
legendpar = LBLegendParameters(colors=colrange, base_plane=base_plane)  # -> leg_par; plug-in component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
incidentradiation = LBIncidentRadiation(
    sky_mtx=skymatrix.sky_mtx,
    geometry=flatten(geometry),
    context=flatten(context),
    grid_size=grid_size,
    offset_dist=Slider(0.2, range=0..1),
    legend_par=legendpar,
    run=run)  # -> report, points, results, total, mesh, legend, title, int_mtx; plug-in component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
legend = ClusterOutput(incidentradiation.legend)
results = ClusterOutput(incidentradiation.results)
mesh = ClusterOutput(incidentradiation.mesh)
points = ClusterOutput(incidentradiation.points)

# ==== cluster RadiationSimulation
colrange = LBColorRange(index=Slider(0, range=0..100))  # -> colors; plug-in component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
sky_mtx = ClusterInput()
context = ClusterInput()
geometry = ClusterInput()
run = ClusterInput()
legendpar = LBLegendParameters(colors=colrange)  # -> leg_par; plug-in component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
incidentradiation = LBIncidentRadiation(
    sky_mtx=sky_mtx,
    geometry=flatten(geometry),
    context=flatten(context),
    grid_size=Slider(1, range=0..1),
    offset_dist=Slider(0.2, range=0..1),
    legend_par=legendpar,
    run=run)  # -> report, points, results, total, mesh, legend, title, int_mtx; plug-in component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
legend = ClusterOutput(incidentradiation.legend)
mesh = ClusterOutput(incidentradiation.mesh)
